% Simulink data dictionary LED.sldd

a = 1
b = 2
Configuration = Simulink.ConfigSet(StartTime="0", StopTime="inf", FixedStep="0.001", Solver="FixedStepAuto", ProdHWDeviceType="Intel->x86-64 (Windows64)", SystemTargetFile="ert.tlc", TargetLang="C")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
LedOutput = Simulink.Signal(DataType="double")
Sig = Simulink.Signal()